# Grasshopper definition model_sim.gh (Grasshopper 1.0.7)
# plug-ins: LunchBox, MetaHopper

# ---- group: General
yz = YZPlane(Origin=Point(0, 0, 0))
# Data
path = FilePath("C:\Users\Leopold\Documents\Testprojekte\Uni\SE Project\Pics\")

# ---- group: Design Parameters
bridge_length = Slider(40, range=40..45, expression="x*10")
main_opening = Slider(24, range=24..30, expression="x*5")
road_width = Slider(8, range=8..10)
deck_height = Slider(20, range=20..25)

# ---- group: Permutations Generator
# Alternative 1 / Combined Bridge
panel = Panel("alt1")
reset = Button()
run = BooleanToggle(False)
speed = ValueList({"Fast": 0, "Medium": 0.05, "Slow": 0.1, "Cinematic": 0.5}, selected="Slow")
view = BooleanToggle(False)
n = Slider(0, range=0..100)
python = GhPythonScript(
    scenario=panel,
    reset=reset,
    run=run,
    speed=speed,
    slider=[main_opening, road_width, deck_height, bridge_length],
    export_input=view,
    n_captures=n,
    directory=path)  # -> out, steps, step_sizes, input, names, intervals; inputs slider: list
# ---------- python: Python ----------
"""Permutations Generator"""

__author__ = "Leopold Mueller"
__version__ = "2024v03"

import Rhino as rc
import os
import re
import rhinoscriptsyntax as rs
from scriptcontext import sticky
import Grasshopper as gh
import time
import itertools
import ghpythonlib.treehelpers as th

def extract_numbers(expression):
    numbers = []
    for e in expression:
        if e:
            match = re.search(r'x\*(\d+(\.\d+)?)', e)
            if match:
                numbers.append(float(match.group(1)))
            else:
                numbers.append(1)
        else:
            numbers.append(1)
    return numbers

def update_component():
    """Updates this component, similar to using a Grasshopper timer."""
    # written by Anders Deleuran (andersholdendeleuran.com)
    def call_back(e):
        """Defines a callback action"""
        ghenv.Component.ExpireSolution(False)
    # Get the Grasshopper document
    ghDoc = ghenv.Component.OnPingDocument() 
    # Schedule this component to expire
    ghDoc.ScheduleSolution(1, \
        gh.Kernel.GH_Document.GH_ScheduleDelegate(call_back))

# Get slider objects -> index important!
get_object = ghenv.Component.Params.Input[4].Sources

# Extract slider data
slider_ranges = []
slider_steps = []
slider_expr = []
names = []
for i in range(len(get_object)):
    slider_ranges.append(range(get_object[i].Slider.Minimum, get_object[i].Slider.Maximum+1))
    slider_steps.append(len(list(slider_ranges[i])))
    slider_expr.append(get_object[i].Expression)
    names.append(get_object[i].NickName)

# adjust ranges given the slider expressions
slider_expr = extract_numbers(slider_expr)
slider_ranges_expr = []
for i in range(len(slider_ranges)):
    temp_list = []
    for j in range(len(slider_ranges[i])):
        temp_list.append(slider_ranges[i][j]*slider_expr[i])
    slider_ranges_expr.append(temp_list)

# ouput parameter data
intervals = []
for sublist in slider_ranges_expr:
    min_value = float(sublist[0])
    max_value = float(sublist[-1])
    intervals.append("[{}, {}]".format(min_value, max_value))

steps = slider_steps
step_sizes = slider_expr

# Calculate permutations of slider inputs w/ and w/o expressions
permutations = list(itertools.product(*slider_ranges))
permutations_expr = list(itertools.product(*slider_ranges_expr))
if export_input:
    input = th.list_to_tree(permutations_expr)

print("Estimated duration: t > {} min".format(int(round(len(permutations)*(speed+0.01)/60)) if speed > 0 else "?"))

# Reset button action
if reset and "count" in sticky.keys():
    sticky.pop("count", None)
    ghenv.Component.Message = "Ready\nn = {:,}".format(len(permutations))
elif reset:
    update_component()
    ghenv.Component.Message = "Ready\nn = {:,}".format(len(permutations))

# Run button action
if run:
    if not "count" in sticky.keys():
        count = 0
        sticky["count"] = count
        update_component()
        
    else:
         
        count = sticky["count"]
        if count < len(permutations):
            print "Current permutation: {}".format(permutations[count])
            
            for i in range(len(slider)):
                get_object[i].Slider.Value = permutations[count][i]
            
            ghenv.Component.Message = "Running... {:,}/{:,}".format(count+1,len(permutations))
            
            # Capture viewport
            # Source: #https://discourse.mcneel.com/t/automatic-snapshots-in-different-rhino-viewpoints-python-script/139755/3
            if n_captures != 0:
                if (count+1) % int(len(permutations)/n_captures) == 0:
                    file_path = directory + scenario + "_" + str(count+1) + ".png"
                    file_path = file_path.replace("\\","\\\\")
                    if rc.RhinoApp.RunScript('-ViewCaptureToFile "{}"'.format(file_path), echo=True):
                        print "Viewport captured: " + os.path.normpath(file_path)
            
            time.sleep(speed)
            update_component()
            count += 1
            sticky["count"] = count

        else:
            print("---Iteration Finished---")
            ghenv.Component.Message = "Finished!"
# ---------- end python ----------

# ---- group: Design Parameters
road_width_2 = Slider(10, range=8..10)
tunnel_height = Slider(11, range=11..14, expression="x*0.5")
wall_thickness = Slider(10, range=10..15, expression="x*0.1")
tube_count = Slider(2, range=2..3)
tunnel_length = Slider(40, range=40..45, expression="x*10")

# ---- group: Permutations Generator
reset_2 = Button()
run_2 = BooleanToggle(False)
speed_2 = ValueList({"Fast": 0, "Medium": 0.05, "Slow": 0.1, "Cinematic": 0.5}, selected="Fast")
view_2 = BooleanToggle(False)
n_2 = Slider(0, range=0..100)
# Alternative 3 / Immersed Tunnel
panel_2 = Panel("alt3")
python_2 = GhPythonScript(
    scenario=panel_2,
    reset=reset_2,
    run=run_2,
    speed=speed_2,
    slider=[tube_count, road_width_2, tunnel_height, wall_thickness, tunnel_length],
    export_input=view_2,
    n_captures=n_2,
    directory=path)  # -> out, steps, step_sizes, input, names, intervals; inputs slider: list; same code as python

# ---- group: Design Parameters
bridge_length_2 = Slider(40, range=40..45, expression="x*10")
main_opening_2 = Slider(30, range=24..30, expression="x*5")
road_width_3 = Slider(9, range=8..10)
deck_height_2 = Slider(23, range=20..25)

# ---- group: Permutations Generator
reset_3 = Button()
run_3 = BooleanToggle(False)
speed_3 = ValueList({"Fast": 0, "Medium": 0.05, "Slow": 0.1, "Cinematic": 0.5}, selected="Fast")
view_3 = BooleanToggle(False)
# Alternative 2 / Seperate Bridges
panel_3 = Panel("alt2")
n_3 = Slider(0, range=0..100)
python_3 = GhPythonScript(
    scenario=panel_3,
    reset=reset_3,
    run=run_3,
    speed=speed_3,
    slider=[main_opening_2, road_width_3, deck_height_2, bridge_length_2],
    export_input=view_3,
    n_captures=n_3,
    directory=path)  # -> out, steps, step_sizes, input, names, intervals; inputs slider: list; same code as python

# ---- group: Design Parameters
tunnel_length_2 = Slider(45, range=40..45, expression="x*10")
tube_count_2 = Slider(2, range=2..3)
road_width_4 = Slider(10, range=8..10)
wall_thickness_2 = Slider(6, range=6..10, expression="x*0.1")
tunnel_depth = Slider(7, range=5..7, expression="x*2")

# ---- group: Permutations Generator
reset_4 = Button()
run_4 = BooleanToggle(False)
speed_4 = ValueList({"Fast": 0, "Medium": 0.05, "Slow": 0.1, "Cinematic": 0.5}, selected="Fast")
view_4 = BooleanToggle(False)
n_4 = Slider(0, range=0..100)
# Alternative 4 / Bored Tunnel
panel_4 = Panel("alt4")
python_4 = GhPythonScript(
    scenario=panel_4,
    reset=reset_4,
    run=run_4,
    speed=speed_4,
    slider=[tube_count_2, road_width_4, wall_thickness_2, tunnel_length_2, tunnel_depth],
    export_input=view_4,
    n_captures=n_4,
    directory=path)  # -> out, steps, step_sizes, input, names, intervals; inputs slider: list; same code as python

# ---- group: Canvas
# Analysis
# Model
toggle = BooleanToggle(False)
canvascap = CaptureGHCanvas(Capture=toggle, ScaleFactor=0.1, SaveLocation=path, BackgroundColor=ColourSwatch(SwatchColor=RGB(255, 255, 255)))

# ----
panel_5 = Panel(python.out)
panel_6 = Panel(python_2.out)
panel_7 = Panel(python_3.out)
panel_8 = Panel(python_4.out)

# ---- group: Finetuning
piers_width = Slider(2, range=1..8)
piers_length = Slider(5, range=1..8)
num_piers = Slider(3, range=1..10, expression="x*2")
train_track_height = Slider(2, range=0..20)
rail_width = Slider(6, range=6..10)
distance = Slider(60, range=0..100)
pt = Point(yz)
merge = Merge(Data1=road_width_3, Data2=rail_width)
Y = UnitY(Factor=distance)

piers_width_2 = Slider(3, range=1..8)
piers_length_2 = Slider(6, range=1..8)
num_piers_2 = Slider(3, range=1..10, expression="x*2")
train_track_height_2 = Slider(8, range=0..20)
pt_2 = Point(yz)

# ---- group: Tunnel Section
Y_2 = UnitY(Factor=road_width_4)
Z = UnitZ(Factor=road_width_4)
pt_3 = Point(yz)
move = Move(Geometry=pt_3, Motion=expr("0.5*x", Y_2))  # -> Geometry, Transform
move_2 = Move(Geometry=move.Geometry, Motion=expr("0.75*x", Z))  # -> Geometry, Transform
move_3 = Move(Geometry=pt_3, Motion=Y_2)  # -> Geometry, Transform
ln = Line(StartPoint=pt_3, EndPoint=move_3.Geometry)
circle = Circle3Pt(PointA=pt_3, PointB=move_3.Geometry, PointC=move_2.Geometry)  # -> Circle, Plane, Radius
offset = OffsetCurve(Curve=circle.Circle, Distance=wall_thickness_2, Corners=1)
Z_2 = UnitZ(Factor=wall_thickness_2)
move_4 = Move(Geometry=ln, Motion=expr("-x", Z_2))  # -> Geometry, Transform
boundary = BoundarySurfaces(Edges=circle.Circle)
sdiff = SolidDifference(BrepsA=circle.Circle, BrepsB=offset)
srfsplit = SurfaceSplit(Surface=boundary, Curves=[ln, move_4.Geometry])
item = ListItem(List=srfsplit, Index=2, Wrap=True)
join = BrepJoin(Breps=[item, sdiff])  # -> Breps, Closed
series = Series(Start=0, Step=expr("2*x", road_width_4), Count=tube_count_2)
fmerge = MergeFaces(Brep=join.Breps)  # -> Breps, Before, After
Y_3 = UnitY(Factor=series)
move_5 = Move(Geometry=fmerge.Breps, Motion=Y_3)  # -> Geometry, Transform

# ---- group: Piers
subtraction = Subtraction(A=bridge_length, B=main_opening)
division = Division(A=subtraction, B=num_piers_2)
X = UnitX(Factor=bridge_length)
move_6 = Move(Geometry=pt_2, Motion=expr("x/2", X))  # -> Geometry, Transform
series_2 = Series(Start=0, Step=division, Count=expr("x/2+1", num_piers_2))
yz_2 = YZPlane(Origin=move_6.Geometry)
X_2 = UnitX(Factor=series_2)
move_7 = Move(Geometry=pt_2, Motion=X_2)  # -> Geometry, Transform
mirror = Mirror(Geometry=move_7.Geometry, Plane=yz_2)  # -> Geometry, Transform
lng = ListLength(List=move_7.Geometry)  # -> expr("x-1", Length)
lng_2 = ListLength(List=mirror.Geometry)  # -> expr("x-1", Length)
subtraction_2 = Subtraction(A=road_width, B=piers_length_2)
split = SplitList(List=move_7.Geometry, Index=lng)  # -> ListA, ListB
split_2 = SplitList(List=mirror.Geometry, Index=lng_2)  # -> ListA, ListB
addition = Addition(A=piers_length_2, B=subtraction_2)
dom = ConstructDomain(DomainStart=expr("-x-2", addition), DomainEnd=expr("x+2", addition))
merge_2 = Merge(Data1=split.ListB, Data2=split_2.ListB)
dom_2 = ConstructDomain(DomainStart=expr("-x", piers_length_2), DomainEnd=piers_length_2)
dom_3 = ConstructDomain(DomainStart=expr("-x", piers_width_2), DomainEnd=piers_width_2)
merge_3 = Merge(Data1=split.ListA, Data2=split_2.ListA)
rectangle = Rectangle(Plane=merge_3, XSize=dom_3, YSize=dom_2, Radius=0)  # -> Rectangle, Length
rectangle_2 = Rectangle(Plane=merge_2, XSize=dom_3, YSize=dom, Radius=0)  # -> Rectangle, Length
boxrec = BoxRectangle(Rectangle=[rectangle.Rectangle, rectangle_2.Rectangle], Height=deck_height)

# ---- group: Tunnel Section
addition_2 = Addition(A=road_width_2, B=wall_thickness)
multiplication = Multiplication(A=addition_2, B=tube_count)
rectangle_3 = Rectangle(Plane=yz, XSize=road_width_2, YSize=tunnel_height, Radius=0)  # -> Rectangle, Length
addition_3 = Addition(A=wall_thickness, B=multiplication)
addition_4 = Addition(A=tunnel_height, B=wall_thickness, C=wall_thickness)
series_3 = Series(Start=0, Step=addition_2, Count=tube_count)
vec = VectorXYZ(XComponent=0, YComponent=expr("-x", wall_thickness), ZComponent=expr("-x", wall_thickness))  # -> Vector, Length
rectangle_4 = Rectangle(Plane=yz, XSize=addition_3, YSize=addition_4, Radius=0)  # -> Rectangle, Length
Y_4 = UnitY(Factor=series_3)
move_8 = Move(Geometry=rectangle_4.Rectangle, Motion=vec.Vector)  # -> Geometry, Transform
move_9 = Move(Geometry=rectangle_3.Rectangle, Motion=Y_4)  # -> Geometry, Transform
sdiff_2 = SolidDifference(BrepsA=move_8.Geometry, BrepsB=move_9.Geometry)

# ---- group: Deck
addition_5 = Addition(A=deck_height, B=train_track_height_2)
vec_2 = VectorXYZ(XComponent=expr("-x", piers_width_2), YComponent=expr("-x", road_width), ZComponent=addition_5)  # -> Vector, Length
vec_3 = VectorXYZ(XComponent=expr("-x", piers_width_2), YComponent=road_width, ZComponent=addition_5)  # -> Vector, Length
move_10 = Move(Geometry=pt_2, Motion=vec_3.Vector)  # -> Geometry, Transform
move_11 = Move(Geometry=pt_2, Motion=vec_2.Vector)  # -> Geometry, Transform
item_2 = ListItem(List=boxrec, Index=0, Wrap=True)
box_corners = BoxCorners(Box=item_2)  # -> CornerA, CornerB, CornerC, CornerD, CornerE, CornerF, CornerG, CornerH
num = Number(expr("2*x", piers_width_2))
merge_4 = Merge(Data1=move_11.Geometry, Data2=move_10.Geometry, Data3=box_corners.CornerH, Data4=box_corners.CornerE)  # -> flatten(Result)
addition_6 = Addition(A=bridge_length, B=num)
X_3 = UnitX(Factor=addition_6)
pline = PolyLine(Vertices=merge_4, Closed=True)
extr = Extrude(Base=pline, Direction=X_3)

# ---- group: Piers
subtraction_3 = Subtraction(A=bridge_length_2, B=main_opening_2)
division_2 = Division(A=subtraction_3, B=num_piers)
X_4 = UnitX(Factor=bridge_length_2)
move_12 = Move(Geometry=pt, Motion=expr("x/2", X_4))  # -> Geometry, Transform
series_4 = Series(Start=0, Step=division_2, Count=expr("x/2+1", num_piers))
yz_3 = YZPlane(Origin=move_12.Geometry)
X_5 = UnitX(Factor=series_4)
move_13 = Move(Geometry=pt, Motion=X_5)  # -> Geometry, Transform
mirror_2 = Mirror(Geometry=move_13.Geometry, Plane=yz_3)  # -> Geometry, Transform
lng_3 = ListLength(List=move_13.Geometry)  # -> expr("x-1", Length)
lng_4 = ListLength(List=mirror_2.Geometry)  # -> expr("x-1", Length)
subtraction_4 = Subtraction(A=merge, B=piers_length)
split_3 = SplitList(List=move_13.Geometry, Index=lng_3)  # -> ListA, ListB
split_4 = SplitList(List=mirror_2.Geometry, Index=lng_4)  # -> ListA, ListB
addition_7 = Addition(A=piers_length, B=subtraction_4)
merge_5 = Merge(Data1=split_3.ListB, Data2=split_4.ListB)
dom_4 = ConstructDomain(DomainStart=expr("-x-2", addition_7), DomainEnd=expr("x+2", addition_7))  # -> reverse(Domain)
dom_5 = ConstructDomain(DomainStart=expr("-x", piers_length), DomainEnd=piers_length)
dom_6 = ConstructDomain(DomainStart=expr("-x", piers_width), DomainEnd=piers_width)
merge_6 = Merge(Data1=split_3.ListA, Data2=split_4.ListA)
dup = DuplicateData(Data=graft(dom_4), Number=2, Order=False)
rectangle_5 = Rectangle(Plane=merge_6, XSize=dom_6, YSize=dom_5, Radius=0)  # -> Rectangle, Length
move_14 = Move(Geometry=rectangle_5.Rectangle, Motion=Y)  # -> Geometry, Transform
move_15 = Move(Geometry=merge_5, Motion=Y)  # -> Geometry, Transform
rectangle_6 = Rectangle(Plane=[merge_5, move_15.Geometry], XSize=dom_6, YSize=flatten(dup), Radius=0)  # -> Rectangle, Length
unflatten = UnflattenTree(Tree=rectangle_6.Rectangle, Guide=dup)
entwine = Entwine(Branch00=rectangle_5.Rectangle, Branch01=move_14.Geometry, FlattenInputs=True)
trim = TrimTree(Tree=unflatten, Depth=1)
merge_7 = Merge(Data1=entwine, Data2=trim)
boxrec_2 = BoxRectangle(Rectangle=merge_7, Height=deck_height_2)

# ---- group: Deck
Z_3 = UnitZ(Factor=train_track_height)
addition_8 = Addition(A=deck_height_2, B=train_track_height)
vec_4 = VectorXYZ(XComponent=expr("-x", piers_width), YComponent=expr("-x", merge), ZComponent=addition_8)  # -> Vector, Length
vec_5 = VectorXYZ(XComponent=expr("-x", piers_width), YComponent=merge, ZComponent=addition_8)  # -> Vector, Length
addition_9 = Addition(A=vec_4.Vector, B=Y)
addition_10 = Addition(A=vec_5.Vector, B=Y)
move_16 = Move(Geometry=pt, Motion=[vec_5.Vector, addition_10])  # -> Geometry, Transform
move_17 = Move(Geometry=pt, Motion=[vec_4.Vector, addition_9])  # -> Geometry, Transform
cull = CullPattern(List=move_17.Geometry, CullPattern=[False, True, True, False])  # -> graft(List)
cull_2 = CullPattern(List=move_16.Geometry, CullPattern=[False, True, True, False])  # -> graft(List)
item_3 = ListItem(List=boxrec_2, Index=0, Wrap=True)
box_corners_2 = BoxCorners(Box=item_3)  # -> CornerA, CornerB, CornerC, CornerD, CornerE, CornerF, CornerG, CornerH
num_2 = Number(expr("2*x", piers_width))
move_18 = Move(Geometry=box_corners_2.CornerE, Motion=expr("0.75*x", Z_3))  # -> Geometry, Transform
move_19 = Move(Geometry=box_corners_2.CornerH, Motion=expr("0.75*x", Z_3))  # -> Geometry, Transform
merge_8 = Merge(
    Data1=cull,
    Data2=cull_2,
    Data3=move_19.Geometry,
    Data4=box_corners_2.CornerH,
    Data5=box_corners_2.CornerE,
    Data6=move_18.Geometry)
addition_11 = Addition(A=bridge_length_2, B=num_2)
X_6 = UnitX(Factor=addition_11)
pline_2 = PolyLine(Vertices=merge_8, Closed=True)
extr_2 = Extrude(Base=pline_2, Direction=X_6)

# ---- group: Tunnel Extrusion
X_7 = UnitX(Factor=tunnel_length)
move_20 = Move(Geometry=yz, Motion=X_7)  # -> Geometry, Transform
ln_2 = Line(StartPoint=yz, EndPoint=move_20.Geometry)
extrcrv = ExtrudeAlong(Base=sdiff_2, Curve=ln_2)

vec_6 = VectorXYZ(XComponent=expr("0.5*x", tunnel_length_2), YComponent=0, ZComponent=expr("-x", tunnel_depth))  # -> Vector, Length
X_8 = UnitX(Factor=tunnel_length_2)
move_21 = Move(Geometry=yz, Motion=X_8)  # -> Geometry, Transform
move_22 = Move(Geometry=yz, Motion=vec_6.Vector)  # -> Geometry, Transform
arc = Arc3Pt(PointA=yz, PointB=move_22.Geometry, PointC=move_21.Geometry)  # -> Arc, Plane, Radius
extrcrv_2 = ExtrudeAlong(Base=move_5.Geometry, Curve=arc.Arc)

# ---- group: Arches
item_4 = ListItem(List=move_7.Geometry, Index=0, Wrap=True)  # -> Item1, Item
item_5 = ListItem(List=mirror.Geometry, Index=0, Wrap=True)  # -> Item1, Item
merge_9 = Merge(Data1=item_4.Item1, Data2=item_5.Item1)
vec_7 = VectorXYZ(XComponent=0, YComponent=expr("x+2", road_width), ZComponent=deck_height)  # -> Vector, Length
vec_8 = VectorXYZ(XComponent=0, YComponent=expr("-x-2", road_width), ZComponent=deck_height)  # -> Vector, Length
move_23 = Move(Geometry=merge_9, Motion=vec_7.Vector)  # -> Geometry, Transform
move_24 = Move(Geometry=merge_9, Motion=vec_8.Vector)  # -> Geometry, Transform
bang = ExplodeTree(Data=graft(move_23.Geometry))  # -> Branch0, Branch1
bang_2 = ExplodeTree(Data=graft(move_24.Geometry))  # -> Branch0, Branch1
ln_3 = Line(StartPoint=bang.Branch0, EndPoint=bang.Branch1)
ln_4 = Line(StartPoint=bang_2.Branch0, EndPoint=bang_2.Branch1)
midpt = CurveMiddle(Curve=ln_3)
midpt_2 = CurveMiddle(Curve=ln_4)
Z_4 = UnitZ(Factor=expr("x*0.25", main_opening))
Z_5 = UnitZ(Factor=expr("x*0.25", main_opening))
move_25 = Move(Geometry=midpt, Motion=Z_4)  # -> Geometry, Transform
move_26 = Move(Geometry=midpt_2, Motion=Z_5)  # -> Geometry, Transform
arc_2 = Arc3Pt(PointA=bang_2.Branch0, PointB=move_26.Geometry, PointC=bang_2.Branch1)  # -> Arc, Plane, Radius
arc_3 = Arc3Pt(PointA=bang.Branch0, PointB=move_25.Geometry, PointC=bang.Branch1)  # -> Arc, Plane, Radius
eval = EvaluateCurve(Curve=reparameterize(arc_2.Arc), Parameter=0.5)  # -> Point, Tangent, Angle
pflip = FlipPlane(Plane=bang_2.Branch1, ReverseX=True, ReverseY=False, SwapAxes=False)
eval_2 = EvaluateCurve(Curve=reparameterize(arc_3.Arc), Parameter=0.5)  # -> Point, Tangent, Angle
pflip_2 = FlipPlane(Plane=bang.Branch1, ReverseX=True, ReverseY=False, SwapAxes=False)
padjust = AdjustPlane(Plane=move_26.Geometry, Normal=eval.Tangent)
merge_10 = Merge(Data1=bang_2.Branch0, Data2=padjust, Data3=pflip)  # -> flatten(Result)
padjust_2 = AdjustPlane(Plane=move_25.Geometry, Normal=eval_2.Tangent)
merge_11 = Merge(Data1=bang.Branch0, Data2=padjust_2, Data3=pflip_2)  # -> flatten(Result)
rectangle_7 = Rectangle(Plane=merge_10, XSize=Domain(-1, 1), YSize=Domain(0, 2), Radius=0)  # -> Rectangle, Length
rectangle_8 = Rectangle(Plane=merge_11, XSize=Domain(-1, 1), YSize=Domain(-2, 0), Radius=0)  # -> Rectangle, Length
swp1 = Sweep1(Rail=arc_2.Arc, Sections=rectangle_7.Rectangle, Miter=0)
swp1_2 = Sweep1(Rail=arc_3.Arc, Sections=rectangle_8.Rectangle, Miter=0)
merge_12 = Merge(Data1=swp1_2, Data2=swp1)

# ----
piles_depth = Slider(22, range=0..100)
piles_num = Slider(3, range=0..10)

# ---- group: Arches
item_6 = ListItem(List=move_13.Geometry, Index=0, Wrap=True)  # -> Item1, Item
item_7 = ListItem(List=mirror_2.Geometry, Index=0, Wrap=True)  # -> Item1, Item
merge_13 = Merge(Data1=item_6.Item1, Data2=item_7.Item1)
move_27 = Move(Geometry=merge_13, Motion=Y)  # -> Geometry, Transform
vec_9 = VectorXYZ(XComponent=0, YComponent=expr("-x-2", reverse(merge)), ZComponent=deck_height_2)  # -> Vector, Length
vec_10 = VectorXYZ(XComponent=0, YComponent=expr("x+2", reverse(merge)), ZComponent=deck_height_2)  # -> Vector, Length
entwine_2 = Entwine(Branch00=merge_13, Branch01=move_27.Geometry, FlattenInputs=True)
flip = FlipMatrix(Data=entwine_2)
move_28 = Move(Geometry=flip, Motion=vec_9.Vector)  # -> Geometry, Transform
move_29 = Move(Geometry=flip, Motion=vec_10.Vector)  # -> Geometry, Transform
bang_3 = ExplodeTree(Data=move_29.Geometry)  # -> Branch0, Branch1
bang_4 = ExplodeTree(Data=move_28.Geometry)  # -> Branch0, Branch1
ln_5 = Line(StartPoint=bang_3.Branch0, EndPoint=bang_3.Branch1)
ln_6 = Line(StartPoint=bang_4.Branch0, EndPoint=bang_4.Branch1)
midpt_3 = CurveMiddle(Curve=ln_5)
midpt_4 = CurveMiddle(Curve=ln_6)
Z_6 = UnitZ(Factor=expr("x*0.25", main_opening_2))
Z_7 = UnitZ(Factor=expr("x*0.25", main_opening_2))
move_30 = Move(Geometry=midpt_3, Motion=Z_6)  # -> Geometry, Transform
move_31 = Move(Geometry=midpt_4, Motion=Z_7)  # -> Geometry, Transform
arc_4 = Arc3Pt(PointA=bang_4.Branch0, PointB=move_31.Geometry, PointC=bang_4.Branch1)  # -> Arc, Plane, Radius
arc_5 = Arc3Pt(PointA=bang_3.Branch0, PointB=move_30.Geometry, PointC=bang_3.Branch1)  # -> Arc, Plane, Radius
eval_3 = EvaluateCurve(Curve=reparameterize(arc_4.Arc), Parameter=0.5)  # -> Point, Tangent, Angle
pflip_3 = FlipPlane(Plane=bang_4.Branch1, ReverseX=True, ReverseY=False, SwapAxes=False)
eval_4 = EvaluateCurve(Curve=reparameterize(arc_5.Arc), Parameter=0.5)  # -> Point, Tangent, Angle
pflip_4 = FlipPlane(Plane=bang_3.Branch1, ReverseX=True, ReverseY=False, SwapAxes=False)
padjust_3 = AdjustPlane(Plane=move_31.Geometry, Normal=eval_3.Tangent)
entwine_3 = Entwine(Branch00=bang_4.Branch0, Branch01=padjust_3, Branch02=pflip_3, FlattenInputs=True)
padjust_4 = AdjustPlane(Plane=move_30.Geometry, Normal=eval_4.Tangent)
entwine_4 = Entwine(Branch00=bang_3.Branch0, Branch01=padjust_4, Branch02=pflip_4, FlattenInputs=True)
path_mapper = PathMapper(arc_4.Arc, source="{A;B}(i)", target="{B;i}")
path_mapper_2 = PathMapper(arc_5.Arc, source="{A;B}(i)", target="{B;i}")
flip_2 = FlipMatrix(Data=entwine_3)
rectangle_9 = Rectangle(Plane=flip_2, XSize=Domain(-1, 1), YSize=Domain(0, 2), Radius=0)  # -> Rectangle, Length
flip_3 = FlipMatrix(Data=entwine_4)
rectangle_10 = Rectangle(Plane=flip_3, XSize=Domain(-1, 1), YSize=Domain(-2, 0), Radius=0)  # -> Rectangle, Length
swp1_3 = Sweep1(Rail=path_mapper, Sections=rectangle_9.Rectangle, Miter=0)
swp1_4 = Sweep1(Rail=path_mapper_2, Sections=rectangle_10.Rectangle, Miter=0)
merge_14 = Merge(Data1=swp1_4, Data2=swp1_3)

# ----
piles_depth_2 = Slider(18, range=0..100)
piles_num_2 = Slider(3, range=0..10)

# ---- group: Pile Foundation
merge_15 = Merge(Data1=rectangle.Rectangle, Data2=rectangle_2.Rectangle)
offset_2 = OffsetCurve(Curve=merge_15, Distance=4, Corners=1)  # -> flatten(Curve)
boxrec_3 = BoxRectangle(Rectangle=offset_2, Height=Domain(-5, 0))
debrep = DeconstructBrep(Brep=boxrec_3)  # -> Faces, Edges, Vertices
item_8 = ListItem(List=debrep.Faces, Index=4, Wrap=True)
drec = DeconstuctRectangle(Rectangle=flatten(item_8))  # -> BasePlane, XInterval, YInterval
int = Integer(drec.XInterval)
int_2 = Integer(drec.YInterval)
division_3 = Division(A=int, B=piles_num)
division_4 = Division(A=int_2, B=piles_num)
mesh_uv = MeshSurface(Surface=flatten(item_8), UCount=division_3, VCount=division_4, Overhang=True, Equalize=False)
facen = FaceNormals(Mesh=mesh_uv)  # -> Centers, Normals
Z_8 = UnitZ(Factor=piles_depth)  # -> expr("-x", UnitVector)
cir = Circle(Plane=facen.Centers, Radius=1)
boundary_2 = BoundarySurfaces(Edges=cir)
extr_3 = Extrude(Base=boundary_2, Direction=Z_8)
geo = Geometry(flatten(extr_3))
geo_2 = Geometry(boxrec_3)

debrep_2 = DeconstructBrep(Brep=boxrec_2)  # -> Faces, Edges, Vertices
item_9 = ListItem(List=debrep_2.Faces, Index=4, Wrap=True)
trim_2 = TrimTree(Tree=item_9, Depth=1)
offset_3 = OffsetCurve(Curve=trim_2, Distance=3, Corners=1)
trim_3 = TrimTree(Tree=offset_3, Depth=1)
boxrec_4 = BoxRectangle(Rectangle=trim_3, Height=Domain(-4, 0))
debrep_3 = DeconstructBrep(Brep=boxrec_4)  # -> Faces, Edges, Vertices
item_10 = ListItem(List=debrep_3.Faces, Index=4, Wrap=True)
trim_4 = TrimTree(Tree=item_10, Depth=1)
drec_2 = DeconstuctRectangle(Rectangle=trim_4)  # -> BasePlane, XInterval, YInterval
int_3 = Integer(drec_2.XInterval)
int_4 = Integer(drec_2.YInterval)
division_5 = Division(A=int_3, B=piles_num_2)
division_6 = Division(A=int_4, B=piles_num_2)
mesh_uv_2 = MeshSurface(Surface=trim_4, UCount=division_5, VCount=division_6, Overhang=True, Equalize=False)
facen_2 = FaceNormals(Mesh=mesh_uv_2)  # -> Centers, Normals
Z_9 = UnitZ(Factor=piles_depth_2)  # -> expr("-x", UnitVector)
cir_2 = Circle(Plane=facen_2.Centers, Radius=1)
boundary_3 = BoundarySurfaces(Edges=cir_2)
extr_4 = Extrude(Base=boundary_3, Direction=Z_9)
geo_3 = Geometry(boxrec_4)

# ----
geo_4 = Geometry(extr_4)

# ---- group: Cost Performance
volume = Volume(Geometry=extrcrv)  # -> Volume, Centroid
concrete = Multiplication(A=volume.Volume, B="180")
steel = Multiplication(A=volume.Volume, B="0.3", C="1200")
addition_12 = Addition(A=concrete, B=steel)
panel_9 = Panel(addition_12)

volume_2 = Volume(Geometry=extrcrv_2)  # -> Volume, Centroid
ma = MassAddition(Input=volume_2.Volume)  # -> Result, PartialResults
concrete_2 = Multiplication(A=ma.Result, B="180")
steel_2 = Multiplication(A=ma.Result, B="0.4", C="1200")
addition_13 = Addition(A=concrete_2, B=steel_2)
panel_10 = Panel(addition_13)

# ----
python_5 = GhPythonScript(piles=geo, caps=geo_2, piers=boxrec, arches=merge_12, deck=extr)  # -> elements, costs; inputs piles: list, caps: list, piers: list, arches: list, deck: list
# ---------- python_5: Python ----------
__author__ = "Leopold"
__version__ = "2024.02.15"

import rhinoscriptsyntax as rs
import Grasshopper.Kernel.Data as ghp
import Grasshopper.DataTree as ghdt

def get_area(elements):
    area = 0
    for i in range(len(elements)):
        area += rs.coercebrep(elements[i]).GetArea()
    return round(area)

def get_volume(elements):
    volume = 0
    for i in range(len(elements)):
        volume += rs.coercebrep(elements[i]).GetVolume()
    return round(volume)



#-------------------- 3D Model --------------------
# Collecting all inputs automatically
# https://www.grasshopper3d.com/forum/topics/variable-input-parameters-ghpython

elements = ghdt[object]()

for i,input in enumerate(ghenv.Component.Params.Input):
    uniqueI = []
    for item in input.VolatileData:
        uniqueI.append(item)
    path = ghp.GH_Path(i)
    elements.AddRange(uniqueI, path)


#-------------------- Cost Calculation --------------------
# quantities
piles_volume = get_volume(piles)
caps_volume = get_volume(caps)
piers_volume = get_volume(piers)
arches_area = get_area(arches)
deck_area = get_area(deck)

# steel weight (t)
piles_steel = 0.1 * piles_volume
caps_steel = 0.13 * caps_volume
piers_steel = 0.3 * piers_volume

    # 100 cm · 100 cm · 12 cm ÷ 1000 · 7,85 = 942 kg
arches_steel = 0.942 * arches_area
deck_steel = 0.942 * deck_area

steel_weight = sum([piles_steel,caps_steel,piers_steel,arches_steel,deck_steel])

# prices (€)
concrete_volume = sum([piles_volume,caps_volume,piers_volume])
concrete_price = concrete_volume * 180

steel_price = steel_weight * 1200

costs = concrete_price + steel_price
print(costs)
# ---------- end python_5 ----------
trim_5 = TrimTree(Tree=python_5.costs, Depth=2)
panel_11 = Panel(trim_5)

python_6 = GhPythonScript(piles=flatten(geo_4), caps=flatten(geo_3), piers=flatten(boxrec_2), arches=flatten(merge_14), deck=flatten(extr_2))  # -> elements, costs; inputs piles: list, caps: list, piers: list, arches: list, deck: list
# ---------- python_6: Python ----------
__author__ = "Leopold"
__version__ = "2024.02.15"

import rhinoscriptsyntax as rs
import Grasshopper.Kernel.Data as ghp
import Grasshopper.DataTree as ghdt

def get_area(elements):
    area = 0
    for i in range(len(elements)):
        area += rs.coercebrep(elements[i]).GetArea()
    return round(area)

def get_volume(elements):
    volume = 0
    for i in range(len(elements)):
        volume += rs.coercebrep(elements[i]).GetVolume()
    return round(volume)



#-------------------- 3D Model --------------------
# Collecting all inputs automatically
# https://www.grasshopper3d.com/forum/topics/variable-input-parameters-ghpython

elements = ghdt[object]()

for i,input in enumerate(ghenv.Component.Params.Input):
    uniqueI = []
    for item in input.VolatileData:
        uniqueI.append(item)
    path = ghp.GH_Path(i)
    elements.AddRange(uniqueI, path)


#-------------------- Cost Calculation --------------------
# quantities
piles_volume = get_volume(piles)
caps_volume = get_volume(caps)
piers_volume = get_volume(piers)
arches_area = get_area(arches)
deck_area = get_area(deck)

# steel weight (t)
piles_steel = 0.1 * piles_volume
caps_steel = 0.13 * caps_volume
piers_steel = 0.3 * piers_volume

# 100 cm · 100 cm · 12 cm ÷ 1000 · 7,85 = 942 kg
arches_steel = 0.942 * arches_area
deck_steel = 0.942 * deck_area

steel_weight = sum([piles_steel,caps_steel,piers_steel,arches_steel,deck_steel])

# prices (€)
concrete_volume = sum([piles_volume,caps_volume,piers_volume])
concrete_price = concrete_volume * 180

steel_price = steel_weight * 1200

costs = concrete_price + steel_price
print(costs)
# ---------- end python_6 ----------
graft = GraftTree(Tree=python_6.costs, IncludeEmptyLists=True, IncludeNullItems=True)
panel_12 = Panel(graft)

preview = CustomPreview(Geometry=python_5.elements, Material=ColourSwatch(SwatchColor=RGB(176, 176, 176)))

preview_2 = CustomPreview(Geometry=python_6.elements, Material=ColourSwatch(SwatchColor=RGB(176, 176, 176)))

preview_3 = CustomPreview(Geometry=extrcrv_2, Material=ColourSwatch(SwatchColor=RGB(176, 176, 176)))

preview_4 = CustomPreview(Geometry=extrcrv, Material=ColourSwatch(SwatchColor=RGB(176, 176, 176)))

# ---- group: Data Export
trim_6 = TrimTree(Tree=python.names, Depth=1)
alt_1 = DataRecorder(trim_5, DataLimit=-10, RecordData=True)
flip_4 = FlipMatrix(Data=python.input)
trim_7 = TrimTree(Tree=python_3.names, Depth=1)
trim_8 = TrimTree(Tree=python_2.names, Depth=1)
trim_9 = TrimTree(Tree=python_4.names, Depth=1)
alt_2 = DataRecorder(graft, DataLimit=-10, RecordData=True)
flip_5 = FlipMatrix(Data=python_3.input)
alt_3 = DataRecorder(addition_12, DataLimit=-10, RecordData=True)
flip_6 = FlipMatrix(Data=python_2.input)
alt_4 = DataRecorder(addition_13, DataLimit=-10, RecordData=True)
flip_7 = FlipMatrix(Data=python_4.input)
path_mapper_3 = PathMapper(flip_4, source="{A;B}", target="{A;B+1}")
path_mapper_4 = PathMapper(flip_5, source="{A;B}", target="{A;B+1}")
path_mapper_5 = PathMapper(flip_6, source="{A;B}", target="{A;B+1}")
path_mapper_6 = PathMapper(flip_7, source="{A;B}", target="{A;B+1}")
write = Button()
merge_16 = Merge(Data1="material_costs", Data2=trim_6)
merge_17 = Merge(Data1=alt_1, Data2=path_mapper_3)
write_2 = Button()
merge_18 = Merge(Data1="material_costs", Data2=trim_7)
write_3 = Button()
merge_19 = Merge(Data1="material_costs", Data2=trim_8)
write_4 = Button()
merge_20 = Merge(Data1="material_costs", Data2=trim_9)
path_2 = FilePath("C:\Users\Leopold\Documents\Testprojekte\Uni\SE Project\model_data.xlsx")
merge_21 = Merge(Data1=alt_2, Data2=path_mapper_4)
merge_22 = Merge(Data1=alt_3, Data2=path_mapper_5)
merge_23 = Merge(Data1=alt_4, Data2=path_mapper_6)
excelwrite = ExcelWrite(
    WriteExcelData=write,
    WorkbookPath=path_2,
    WorksheetName="alt1_data",
    ColumnHeadings=merge_16,
    Data=merge_17,
    ClearSheet=False)
excelwrite_2 = ExcelWrite(
    WriteExcelData=write_2,
    WorkbookPath=path_2,
    WorksheetName="alt2_data",
    ColumnHeadings=merge_18,
    Data=merge_21,
    ClearSheet=False)
excelwrite_3 = ExcelWrite(
    WriteExcelData=write_3,
    WorkbookPath=path_2,
    WorksheetName="alt3_data",
    ColumnHeadings=merge_19,
    Data=merge_22,
    ClearSheet=False)
excelwrite_4 = ExcelWrite(
    WriteExcelData=write_4,
    WorkbookPath=path_2,
    WorksheetName="alt4_data",
    ColumnHeadings=merge_20,
    Data=merge_23,
    ClearSheet=False)
panel_13 = Panel(alt_1)
panel_14 = Panel(alt_2)
panel_15 = Panel(alt_3)
panel_16 = Panel(alt_4)

# ---- group: Parameter Export
lng_5 = ListLength(List=python_4.names)
lng_6 = ListLength(List=python_2.names)
lng_7 = ListLength(List=python.names)
lng_8 = ListLength(List=python_3.names)
selobj = GetSelectedObjects(AllObjects_Object=[merge_27, merge_25, merge_28])  # -> ComponentObjects, ParamObjects, OtherObjects
dup_2 = DuplicateData(Data=panel_4, Number=lng_5, Order=True)
dup_3 = DuplicateData(Data=panel_2, Number=lng_6, Order=True)
dup_4 = DuplicateData(Data=panel, Number=lng_7, Order=True)
dup_5 = DuplicateData(Data=panel_3, Number=lng_8, Order=True)
list = ValueList({"Normal": 0, "Faint": 1, "Hidden": 2}, selected="Hidden")
panel_17 = Panel("""alternative
parameters
steps
step_size
interval""")
merge_24 = Merge(Data1=python.names, Data2=python_3.names, Data3=python_2.names, Data4=python_4.names)
merge_25 = Merge(Data1=python.intervals, Data2=python_3.intervals, Data3=python_2.intervals, Data4=python_4.intervals)
merge_26 = Merge(Data1=dup_4, Data2=dup_5, Data3=dup_3, Data4=dup_2)
merge_27 = Merge(Data1=python.steps, Data2=python_3.steps, Data3=python_2.steps, Data4=python_4.steps)
merge_28 = Merge(Data1=python.step_sizes, Data2=python_3.step_sizes, Data3=python_2.step_sizes, Data4=python_4.step_sizes)
write_5 = Button()
wiredisplay = ControlWireDisplay(Objects=selobj.ComponentObjects, WireDisplay=list, AllObjects_Object=[merge_27, merge_25, merge_28])
entwine_5 = Entwine(Branch00=merge_26, Branch01=merge_24, Branch02=merge_27, Branch03=merge_28, Branch04=merge_25, FlattenInputs=True)
excelwrite_5 = ExcelWrite(
    WriteExcelData=write_5,
    WorkbookPath=path_2,
    WorksheetName="param_data",
    ColumnHeadings=panel_17,
    Data=entwine_5,
    ClearSheet=False)
